# Grasshopper definition example.gh (Grasshopper 1.0.8)

# ---- group: Print the rhino doc graph
python_3_script = Python3Script()  # -> out
# ---------- python_3_script: Python ----------
import System
import json
import Rhino
import Rhino.Geometry as rg

from System.Collections.Generic import List

import KangarooSolver as ks
from KangarooSolver.Goals import Floor2, RigidBody2, Unary



GRAPH_KEY = "rhinomcp-mod:connectivity-graph"
doc = Rhino.RhinoDoc.ActiveDoc
graph = json.loads(
    doc.Strings.GetValue(GRAPH_KEY)
)

print (graph)
# ---------- end python_3_script ----------

# ----
panel = Panel(python_3_script)
python_3_script_2 = Python3Script(current_step=Slider(10, range=0..100), stability_threshold=Slider(20, range=0..1000))  # -> out, final_geometries, stable, node_transforms, max_displacement, max_length
# ---------- python_3_script_2: Python ----------
import System
import json
import math
import Rhino
import Rhino.Geometry as rg

from System.Collections.Generic import List

import KangarooSolver as ks
from KangarooSolver.Goals import Floor2, RigidBody2, Unary


######################
#### UPDATE GRAPH ####
######################

GRAPH_KEY = "rhinomcp-mod:connectivity-graph"
STABILITY_KEY = "rhinomcp.stability.v1"

doc = Rhino.RhinoDoc.ActiveDoc

graph_text = doc.Strings.GetValue(GRAPH_KEY)

if not graph_text:
    raise ValueError(
        "Connectivity graph not found in Rhino document: {0}".format(GRAPH_KEY)
    )

graph = json.loads(graph_text)


##########################
#### LOAD GEO + MASS ######
##########################

for node in graph["n"]:

    guid = System.Guid(node["g"])
    rhino_object = doc.Objects.FindId(guid)

    if rhino_object is None:
        continue

    node["geo"] = rhino_object.Geometry

    text = rhino_object.Attributes.GetUserString(STABILITY_KEY)

    if not text:
        continue

    data = json.loads(text)

    if "mass" in data:
        node["mass"] = data["mass"]


##########################
#### CHECK MASS ###########
##########################

missing_mass_guids = [
    node.get("g", "<unknown>")
    for node in graph["n"]
    if node.get("mass") is None
]

if missing_mass_guids:
    raise ValueError(
        "Mass is not assigned for node(s): {0}".format(
            ", ".join(missing_mass_guids)
        )
    )


##########################
#### HELPER FUNCTIONS #####
##########################

def _node_mass(node):
    return float(node["mass"])


def _node_geo(node):
    return node.get("geo")


def _duplicate_geo(geo):

    if geo is None:
        return None

    if hasattr(geo, "Duplicate"):
        try:
            return geo.Duplicate()
        except Exception:
            pass

    if isinstance(geo, rg.Brep):
        return geo.DuplicateBrep()

    if isinstance(geo, rg.Mesh):
        return geo.DuplicateMesh()

    if isinstance(geo, rg.Curve):
        return geo.DuplicateCurve()

    return geo


def _as_brep(geo):

    if geo is None:
        return None

    if isinstance(geo, rg.Brep):
        return geo.DuplicateBrep()

    if isinstance(geo, rg.Extrusion):
        return geo.ToBrep()

    if isinstance(geo, rg.Surface):
        return geo.ToBrep()

    if isinstance(geo, rg.Mesh):
        return rg.Brep.CreateFromMesh(geo, True)

    if isinstance(geo, rg.Curve):
        planar = rg.Brep.CreatePlanarBreps(geo, 0.001)
        if planar and len(planar) > 0:
            return planar[0]

    return None


def _as_mesh(geo):

    if geo is None:
        return None

    if isinstance(geo, rg.Mesh):
        return geo.DuplicateMesh()

    b = _as_brep(geo)

    if b is None:
        return None

    meshes = rg.Mesh.CreateFromBrep(b, rg.MeshingParameters.Default)

    if not meshes:
        return None

    m = rg.Mesh()

    for mm in meshes:
        m.Append(mm)

    if m.Vertices.Count == 0:
        return None

    m.Normals.ComputeNormals()
    m.Compact()

    return m


def _mesh_vertices_as_points(mesh):

    if mesh is None:
        return []

    pts = []

    for v in mesh.Vertices:
        pts.append(rg.Point3d(v.X, v.Y, v.Z))

    return pts


def _geometry_center(geo):

    if geo is None:
        return None

    try:
        bbox = geo.GetBoundingBox(True)
        if bbox.IsValid:
            return bbox.Center
    except Exception:
        pass

    return None


##############################
#### TRANSFORM FUNCTIONS ######
##############################

def _transform_matrix(xform):
    return [
        [xform.M00, xform.M01, xform.M02, xform.M03],
        [xform.M10, xform.M11, xform.M12, xform.M13],
        [xform.M20, xform.M21, xform.M22, xform.M23],
        [xform.M30, xform.M31, xform.M32, xform.M33],
    ]


def _rotation(xform):

    cos_angle = (xform.M00 + xform.M11 + xform.M22 - 1.0) * 0.5
    cos_angle = max(-1.0, min(1.0, cos_angle))
    angle = math.acos(cos_angle)

    if angle <= 1e-10:
        axis = rg.Vector3d.Zero

    elif abs(math.pi - angle) <= 1e-6:

        x = math.sqrt(max(0.0, (xform.M00 + 1.0) * 0.5))
        y = math.sqrt(max(0.0, (xform.M11 + 1.0) * 0.5))
        z = math.sqrt(max(0.0, (xform.M22 + 1.0) * 0.5))

        if x >= y and x >= z and x > 1e-10:
            y = (xform.M01 + xform.M10) / (4.0 * x)
            z = (xform.M02 + xform.M20) / (4.0 * x)
        elif y >= z and y > 1e-10:
            x = (xform.M01 + xform.M10) / (4.0 * y)
            z = (xform.M12 + xform.M21) / (4.0 * y)
        elif z > 1e-10:
            x = (xform.M02 + xform.M20) / (4.0 * z)
            y = (xform.M12 + xform.M21) / (4.0 * z)

        axis = rg.Vector3d(x, y, z)
        axis.Unitize()

    else:
        scale = 2.0 * math.sin(angle)
        axis = rg.Vector3d(
            (xform.M21 - xform.M12) / scale,
            (xform.M02 - xform.M20) / scale,
            (xform.M10 - xform.M01) / scale,
        )
        axis.Unitize()

    return {
        "angle_degrees": math.degrees(angle),
        "axis": {"x": axis.X, "y": axis.Y, "z": axis.Z},
    }


def _record_node_transforms(graph, xform, stability_threshold):

    max_displacement = 0.0
    rotation = _rotation(xform)
    matrix = _transform_matrix(xform)

    for node in graph["n"]:

        center = _geometry_center(_node_geo(node))

        if center is None:
            displacement = rg.Vector3d.Zero
            displacement_length = 0.0
        else:
            moved_center = rg.Point3d(center)
            moved_center.Transform(xform)
            displacement = moved_center - center
            displacement_length = displacement.Length

        max_displacement = max(max_displacement, displacement_length)

        node["displacement"] = {
            "x": displacement.X,
            "y": displacement.Y,
            "z": displacement.Z,
            "length": displacement_length,
        }

        node.pop("rotation_degrees", None)
        node["rotation"] = rotation
        node["transform"] = matrix

    graph["stable"] = max_displacement <= stability_threshold
    graph["stability_threshold"] = stability_threshold
    graph["max_displacement"] = max_displacement

    return graph["stable"]


def _serializable_graph(graph):

    result = dict(graph)
    result["n"] = []

    for node in graph["n"]:
        stored_node = dict(node)
        stored_node.pop("geo", None)
        result["n"].append(stored_node)

    return result


########################
#### MAIN SOLVER ########
########################

def solve_from_graph(
    graph,
    current_step,
    stability_threshold,
    rigid_strength=1000.0,
    floor_strength=100.0,
    floor_z=0.0,
    gravity=9.81,
    assign_tol=1e-6,
    threshold=0.05,
    solver_substeps=6,
):

    nodes = graph["n"]

    if not nodes:
        graph["stable"] = True
        graph["stability_threshold"] = stability_threshold
        graph["max_displacement"] = 0.0
        return []

    graph["stable"] = False
    graph["stability_threshold"] = stability_threshold
    graph["max_displacement"] = None


    ######################################
    #### COMBINE INTO ONE RIGID BODY #####
    ######################################

    rigid_mesh = rg.Mesh()
    vertex_points = []
    gravity_loads = []
    collision_pts = List[rg.Point3d]()

    for node in nodes:

        mesh = _as_mesh(_node_geo(node))

        if mesh is None:
            continue

        points = _mesh_vertices_as_points(mesh)

        if len(points) < 3:
            continue

        rigid_mesh.Append(mesh)

        mass_per_point = _node_mass(node) / float(len(points))

        for point in points:
            vertex_points.append(point)
            gravity_loads.append((point, mass_per_point))
            collision_pts.Add(point)

    if len(vertex_points) < 3 or rigid_mesh.Vertices.Count == 0:
        return []

    rigid_mesh.Normals.ComputeNormals()

    if rigid_mesh.Vertices.Count != len(vertex_points):
        raise ValueError(
            "Rigid mesh vertices and source points are not one-to-one"
        )


    ######################################
    #### BUILD SOLVER REFERENCE PLANE #####
    ######################################
    # RigidBody2 automatically adds Pl.Origin as PPos[0].
    # Therefore Pl.Origin must NOT be one of the mesh vertices, otherwise
    # PPos[0] and one of PPos[1:] collapse to the same PhysicalSystem particle.

    i0 = 0
    seed_p0 = vertex_points[i0]

    i1 = max(
        range(len(vertex_points)),
        key=lambda i: vertex_points[i].DistanceToSquared(seed_p0)
    )
    seed_p1 = vertex_points[i1]

    v01 = seed_p1 - seed_p0
    i2 = None
    max_cross_sq = -1.0

    for i, pt in enumerate(vertex_points):
        if i == i0 or i == i1:
            continue
        cross = rg.Vector3d.CrossProduct(v01, pt - seed_p0)
        csq = cross.SquareLength
        if csq > max_cross_sq:
            max_cross_sq = csq
            i2 = i

    if i2 is None or max_cross_sq <= 1e-16:
        print("ERROR: could not find 3 non-collinear vertices")
        return []

    seed_p2 = vertex_points[i2]
    seed_plane = rg.Plane(seed_p0, seed_p1, seed_p2)

    # Put RigidBody2's orientation particle at the combined geometry centre,
    # not on a mesh vertex. This avoids the PIndex [0, 0, ...] duplication
    # caused by Plane.Origin == one of Pts.
    combined_bbox = rigid_mesh.GetBoundingBox(True)
    solver_origin = combined_bbox.Center
    solver_plane = rg.Plane(solver_origin, seed_plane.XAxis, seed_plane.YAxis)

    print("")
    print("======================================")
    print("RIGIDBODY2 SOLVER REFERENCE PLANE")
    print("======================================")
    print("solver origin: ({:.6f}, {:.6f}, {:.6f})".format(
        solver_origin.X, solver_origin.Y, solver_origin.Z
    ))
    print("mesh vertex count:", len(vertex_points))
    print("======================================")
    print("")


    ######################################
    #### BUILD rigid_goal_pts ############
    ######################################

    rigid_goal_pts = List[rg.Point3d]()

    # Keep ALL vertices: all input objects are intentionally welded into one
    # giant rigid body. Coincident vertices may share a global particle later.
    for point in vertex_points:
        rigid_goal_pts.Add(point)


    ######################################
    #### CREATE RIGIDBODY2 ###############
    ######################################

    body_brep = rg.Brep.CreateFromMesh(rigid_mesh, True)

    if body_brep is None:
        return []

    rb_goal = RigidBody2(
        body_brep,
        solver_plane,
        rigid_goal_pts,
        rigid_strength
    )

    goals = List[ks.IGoal]()
    goals.Add(rb_goal)


    ######################################
    #### GRAVITY #########################
    ######################################

    for point, mass_per_point in gravity_loads:
        goals.Add(
            Unary(point, rg.Vector3d(0.0, 0.0, -gravity * mass_per_point))
        )


    ######################################
    #### FLOOR ###########################
    ######################################

    if collision_pts.Count > 0:
        goals.Add(Floor2(collision_pts, floor_strength, floor_z))


    ######################################
    #### PHYSICAL SYSTEM #################
    ######################################

    ps = ks.PhysicalSystem()

    for goal in goals:
        ps.AssignPIndex(goal, assign_tol)


    ######################################
    #### PICK 3 TRACKING PARTICLES ########
    ######################################
    # RigidBody2 layout is:
    #   PPos[0]     = solver_plane.Origin (orientation particle)
    #   PPos[1 + i] = vertex_points[i]
    #
    # Coincident mesh vertices are allowed to map to the same global particle
    # because the whole assembly is intentionally welded. For reconstructing
    # the final rigid transform, however, choose 3 DISTINCT global particles
    # whose initial positions are non-collinear.

    ppos = rb_goal.PPos
    pidx_pre = rb_goal.PIndex

    unique_vertex_records = []
    seen_global = set()

    for vi, pt in enumerate(vertex_points):
        local_i = vi + 1
        global_i = int(pidx_pre[local_i])

        if global_i in seen_global:
            continue

        seen_global.add(global_i)
        unique_vertex_records.append((vi, local_i, global_i, pt))

    if len(unique_vertex_records) < 3:
        print("ERROR: fewer than 3 distinct rigid-body particles after AssignPIndex")
        return []

    rec0 = unique_vertex_records[0]
    track_p0 = rec0[3]

    rec1 = max(
        unique_vertex_records[1:],
        key=lambda rec: rec[3].DistanceToSquared(track_p0)
    )
    track_p1 = rec1[3]
    track_v01 = track_p1 - track_p0

    rec2 = None
    best_cross_sq = -1.0

    for rec in unique_vertex_records:
        if rec[2] == rec0[2] or rec[2] == rec1[2]:
            continue

        cross = rg.Vector3d.CrossProduct(track_v01, rec[3] - track_p0)
        csq = cross.SquareLength

        if csq > best_cross_sq:
            best_cross_sq = csq
            rec2 = rec

    if rec2 is None or best_cross_sq <= 1e-16:
        print("ERROR: could not find 3 non-collinear DISTINCT global particles")
        return []

    track_p2 = rec2[3]

    global_p0 = rec0[2]
    global_p1 = rec1[2]
    global_p2 = rec2[2]

    init_track_plane = rg.Plane(track_p0, track_p1, track_p2)

    print("")
    print("======================================")
    print("RIGIDBODY2 MAPPING")
    print("======================================")
    print("rigid_goal_pts Count:", rigid_goal_pts.Count)
    print("PPos Count:", len(ppos))
    print("PIndex Count:", len(pidx_pre))
    print("PIndex:", list(pidx_pre))
    print("orientation particle PIndex[0]:", pidx_pre[0])
    print("tracking globals:", global_p0, global_p1, global_p2)
    print("tracking vertex indices:", rec0[0], rec1[0], rec2[0])
    print("======================================")
    print("")

    if int(pidx_pre[0]) in (global_p0, global_p1, global_p2):
        print("WARNING: orientation particle shares a tracking particle unexpectedly")


    ######################################
    #### RUN SOLVER ######################
    ######################################

    for _step in range(int(current_step)):
        for _sub in range(int(solver_substeps)):
            ps.Step(goals, True, threshold)


    ######################################
    #### FINAL POSITIONS #################
    ######################################

    positions = ps.GetPositionArray()
    pidx = rb_goal.PIndex


    ######################################
    #### DEBUG 2: PINDEX MAPPING #########
    ######################################

    print("")
    print("======================================")
    print("DEBUG 2 - RigidBody2 PIndex Mapping (after solving)")
    print("======================================")
    print("PIndex:", list(pidx))
    print("Total PhysicalSystem particles:", len(positions))

    for i, idx in enumerate(pidx):
        p = positions[idx]
        print("PIndex mapping {} -> global {} -> ({:.6f}, {:.6f}, {:.6f})".format(
            i, idx, p.X, p.Y, p.Z
        ))

    print("======================================")
    print("")


    ######################################
    #### REBUILD RIGID TRANSFORM ##########
    ######################################
    # We intentionally reconstruct the body transform from 3 distinct
    # non-collinear rigid-body particles. This works even though coincident
    # vertices elsewhere in the welded assembly share particles.

    now_p0 = positions[global_p0]
    now_p1 = positions[global_p1]
    now_p2 = positions[global_p2]

    print("")
    print("======================================")
    print("RIGID TRANSFORM RECONSTRUCTION")
    print("======================================")
    print("Frame global particle indices:", global_p0, global_p1, global_p2)
    print("INITIAL P0: {},{},{}".format(track_p0.X, track_p0.Y, track_p0.Z))
    print("FINAL   P0: {},{},{}".format(now_p0.X, now_p0.Y, now_p0.Z))
    print("INITIAL P1: {},{},{}".format(track_p1.X, track_p1.Y, track_p1.Z))
    print("FINAL   P1: {},{},{}".format(now_p1.X, now_p1.Y, now_p1.Z))
    print("INITIAL P2: {},{},{}".format(track_p2.X, track_p2.Y, track_p2.Z))
    print("FINAL   P2: {},{},{}".format(now_p2.X, now_p2.Y, now_p2.Z))

    # Guard against a degenerate final frame.
    final_v01 = now_p1 - now_p0
    final_v02 = now_p2 - now_p0
    final_cross = rg.Vector3d.CrossProduct(final_v01, final_v02)

    if final_cross.SquareLength <= 1e-16:
        print("ERROR: final tracking particles became collinear")
        return []

    now_track_plane = rg.Plane(now_p0, now_p1, now_p2)
    xform = rg.Transform.PlaneToPlane(init_track_plane, now_track_plane)

    print("transform valid:", xform.IsValid)
    print("======================================")
    print("")


    ######################################
    #### RECORD RESULT ###################
    ######################################

    _record_node_transforms(graph, xform, stability_threshold)


    ######################################
    #### TRANSFORM ORIGINAL GEOMETRY #####
    ######################################

    final_geometries = []

    for node in nodes:

        geo = _node_geo(node)
        dup = _duplicate_geo(geo)

        if dup is not None:
            try:
                dup.Transform(xform)
            except Exception:
                pass
            final_geometries.append(dup)

    return final_geometries


############################
#### RUN ####################
############################

final_geometries = solve_from_graph(
    graph,
    current_step,
    stability_threshold,

    rigid_strength=10000.0,
    floor_strength=1000.0,
    floor_z=0.0,
    gravity=9.81,
    assign_tol=1e-6,
    threshold=0.001,
    solver_substeps=1
)


############################
#### SAVE GRAPH #############
############################

doc.Strings.SetString(
    GRAPH_KEY,
    json.dumps(
        _serializable_graph(graph),
        separators=(",", ":")
    )
)


############################
#### GH OUTPUTS #############
############################

stable = graph.get("stable", False)

max_displacement = graph.get("max_displacement")

max_length = max_displacement

node_transforms = [
    {
        "guid":         node.get("g"),
        "displacement": node.get("displacement"),
        "rotation":     node.get("rotation"),
        "transform":    node.get("transform"),
    }
    for node in graph["n"]
]
# ---------- end python_3_script_2 ----------
panel_2 = Panel(python_3_script_2.stable)
panel_3 = Panel(python_3_script_2.max_displacement)
geometry = Geometry(python_3_script_2.final_geometries)
